# Grasshopper definition 基础案例练习（1）.gh (Grasshopper 1.0.7)
# plug-ins: Bifocals, ChopChop

# ---- group: 随机半径
construct_domain = ConstructDomain(DomainStart=Slider(0, range=0..10), DomainEnd=Slider(10, range=0..10))
random = Random(Range=construct_domain, Number=Slider(6, range=0..10), Seed=Slider(118, range=0..1000))
sort_list = SortList(Keys=random)  # -> Keys, ValuesValuesA

# ----
chopchop = ChopChop()

# ----
# 1、选择一个点
point = Point(<point referenced from the Rhino model>)

# ----
# 2、两两一组形成圆
circle = Circle(Plane=point, Radius=sort_list.Keys)

partition_list = PartitionList(List=circle, Size=Slider(2, range=0..10))
unit_z = UnitZ(Factor=Slider(4.5, range=0..10))

# ----
# 3、两个圆成面
loft = Loft(Curves=partition_list, Options={Adjust=False, Closed=False, LoftEnds=0, LoftSimp=0, LoftType=0, Rebuild=10, Refit=0.01})

# ----
# 4、面成体
extrude = Extrude(Base=loft, Direction=unit_z)

list_item = ListItem(List=circle, Index=0, Wrap=True)

# ----
# 5、获取每个体内的随机点
populate_geometry = PopulateGeometry(Geometry=extrude, Count=Slider(5, range=0..10), Seed=Slider(6.7, range=0..10))

sort_along_curve = SortAlongCurve(Points=populate_geometry, Curve=list_item)  # -> Points, Indices

# ----
# 6、点连成线
interpolate = Interpolate(Vertices=sort_along_curve.Points, Degree=3, Periodic=Toggle(True), KnotStyle=1)  # -> Curve, Length, Domain

# ----
# 7、等分曲线
divide_curve = DivideCurve(Curve=interpolate.Curve, Count=Slider(150, range=0..1000), Kinks=False)  # -> Points, Tangents, Parameters

tree_statistics = TreeStatistics(Tree=divide_curve.Points)  # -> Paths, Length, Count
series = Series(Start=Slider(0, range=0..10), Step=Slider(6, range=0..10), Count=tree_statistics.Count)  # -> graft(Series)
shift_list = ShiftList(List=divide_curve.Points, Shift=series, Wrap=Toggle(True))

# ----
# 8、翻转矩阵组织数据
flip_matrix = FlipMatrix(Data=shift_list)

point_list = PointList(Points=flip_matrix, Size=Slider(0.286, range=0..1))

# ----
# 9、连成折线
polyline = PolyLine(Vertices=flip_matrix, Closed=False)
