# Grasshopper definition 扭曲的有机圆.gh (Grasshopper 1.0.7)
# plug-ins: Bifocals, ChopChop

# ---- group: 建立半径随机的圆并两两分组
construct_domain = ConstructDomain(DomainStart=0, DomainEnd=Slider(100, range=0..100))
random = Random(Range=construct_domain, Number=Slider(6, range=0..10), Seed=Slider(22, range=0..100))

# 扭曲的有机圆
point = Point(<point referenced from the Rhino model>)
sort_list = SortList(Keys=random)  # -> Keys, ValuesValuesA
circle = Circle(Plane=point, Radius=sort_list.Keys)
partition_list = PartitionList(List=circle, Size="2")

# ---- group: 成面挤出
construct_domain_2 = ConstructDomain(DomainStart=0, DomainEnd=Slider(14, range=0..100))
random_2 = Random(Range=construct_domain_2, Number=Slider(3, range=0..10), Seed=Slider(2, range=0..100))  # -> graft(Random)

loft = Loft(Curves=partition_list, Options={Adjust=False, Closed=False, LoftEnds=0, LoftSimp=0, LoftType=0, Rebuild=10, Refit=0.01})
unit_z = UnitZ(Factor=random_2)
extrude = Extrude(Base=loft, Direction=unit_z)

# ----
chopchop = ChopChop()

# ---- group: 建立随机点并连线
curve = Curve(circle)
list_item = ListItem(List=curve, Index=0, Wrap=True)
populate_geometry = PopulateGeometry(Geometry=extrude, Count=Slider(30, range=0..100), Seed=1)
sort_along_curve = SortAlongCurve(Points=populate_geometry, Curve=list_item)  # -> Points, Indices
interpolate = Interpolate(Vertices=sort_along_curve.Points, Degree=3, Periodic=Toggle(True), KnotStyle=1)  # -> Curve, Length, Domain

# ----
panel = Panel(random_2)

curve_2 = Curve(interpolate.Curve)
divide_curve = DivideCurve(Curve=curve_2, Count=Slider(70, range=0..100), Kinks=False)  # -> simplify(Points), Tangents, Parameters

tree_statistics = TreeStatistics(Tree=divide_curve.Points)  # -> Paths, Length, Count
series = Series(Start=Slider(0, range=0..10), Step=Slider(2, range=0..10), Count=tree_statistics.Count)  # -> simplify(graft(Series))

shift_list = ShiftList(List=divide_curve.Points, Shift=series, Wrap=Toggle(True))
flip_matrix = FlipMatrix(Data=shift_list)
polyline = PolyLine(Vertices=flip_matrix, Closed=False)
