# Grasshopper definition Ant Colony Algorithm_Preliminary_20240201.gh (Grasshopper 1.0.7)
# plug-ins: Physarealm, Bifocals, Kangaroo2 Components

# ---- group: Framework
Y = Slider(350, range=0..1000)
# 蚁群算法
# https://www.bilibili.com/video/BV11T4y1H7U5/?spm_id_from=333.999.0.0&vd_source=51fce7bb620ac36682fc7251d41d07f8
X = Slider(500, range=0..1000)
Z = Slider(150, range=0..1000)
number_slider = Slider(10, range=0..10)
number_slider_2 = Slider(5, range=0..10)
domain_box = DomainBox(Base=PlaneXY(0, 0, 0), X=X, Y=Y, Z=Z)
populate_3d = Populate3D(Region=domain_box, Count=number_slider_2, Seed=number_slider_2)
populate_3d_2 = Populate3D(Region=domain_box, Count=number_slider, Seed=number_slider)

# ---- group: 蚁群算法生成过程
box_environment = BoxEnvironment(XResolution=100, YResolution=100, ZResolution=100, Box=domain_box)
boolean_toggle = BooleanToggle(False)
trigger = Trigger(Interval=20, TimerInterval=20, Target=physarealm)  # disabled
points_food = PointsFood(Points=populate_3d_2)
point_emitter = PointEmitter(Points=populate_3d)
physarealm = Physarealm(Environment=box_environment, Emitter=point_emitter, Food=points_food, Reset=boolean_toggle)  # -> ChemoAttractorField, Population, Iteration
population_trail = PopulationTrail(Population=physarealm.Population, HistoryStep=10, Reset=boolean_toggle)
population_locations = PopulationLocations(Population=physarealm.Population)

# ---- group: 点
list_length = ListLength(List=population_locations)
construct_domain = ConstructDomain(DomainStart=Slider(10, range=0..100), DomainEnd=Slider(15, range=0..100))
random = Random(Range=construct_domain, Number=list_length, Seed=Slider(150, range=0..1000))
random_2 = Random(Range=construct_domain, Number=list_length, Seed=Slider(350, range=0..1000))
random_3 = Random(Range=construct_domain, Number=list_length, Seed=Slider(500, range=0..1000))
removeduplicatepts = RemoveDuplicatePts(Points=population_locations, Tolerance=0.01)
domain_box_2 = DomainBox(Base=removeduplicatepts, X=random, Y=random_2, Z=random_3)

# ---- group: 轨迹
nurbs_curve = NurbsCurve(Vertices=population_trail, Degree=3, Periodic=False)  # -> flatten(Curve), flatten(Length), Domain
bounds = Bounds(Numbers=nurbs_curve.Length)
deconstruct_domain = DeconstructDomain(Domain=bounds)  # -> Start, End
gradient = Gradient(
    LowerLimit=deconstruct_domain.Start,
    UpperLimit=deconstruct_domain.End,
    Parameter=nurbs_curve.Length,
    stops=[0: RGB(234, 38, 0), 0.25: RGB(234, 126, 0), 0.5: RGB(254, 244, 84), 0.75: RGB(173, 203, 249), 1: RGB(75, 107, 169)])
custom_preview = CustomPreview(Geometry=nurbs_curve.Curve, Material=gradient)
