# Grasshopper definition Global hourly meteorological data acquisition_20240208.gh (Grasshopper 1.0.7)
# plug-ins: Bifocals, LunchBox, ChopChop

file_path = FilePath("F:\ScientificDatabase\EPW Data Download\CHN_Hubei.Wuhan.574940_SWERA\CHN_Hubei.Wuhan.574940_SWERA.epw")
number_slider = Slider(7, range=0..10)
number_slider_2 = Slider(15, range=0..100)
chopchop = ChopChop()
importepw = LBImportEPW(epw_file=file_path)  # -> location, dry_bulb_temperature, dew_point_temperature, relative_humidity, wind_speed, wind_direction, direct_normal_rad, diffuse_horizontal_rad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; plug-in component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
importepw_2 = LBImportEPW(epw_file=file_path)  # -> location, dry_bulb_temperature, dew_point_temperature, relative_humidity, wind_speed, wind_direction, direct_normal_rad, diffuse_horizontal_rad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; plug-in component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
analysisperiod = LBAnalysisPeriod(
    start_month=number_slider,
    start_day=number_slider_2,
    start_hour=Slider(0, range=0..100),
    end_month=number_slider,
    end_day=number_slider_2,
    end_hour=Slider(23, range=0..100))  # -> period, hoys, dates; plug-in component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
panel = Panel(importepw.relative_humidity)
panel_2 = Panel(analysisperiod.period)

# ---- group: 一项数据提取的结果显示panel
applyper = LBApplyAnalysisPeriod(data=importepw.diffuse_horizontal_rad, period=analysisperiod.period)  # -> data; plug-in component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
xdata = LBDeconstructData(data=applyper)  # -> header, values; plug-in component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
panel_3 = Panel(xdata.values)

# ---- group: 全部数据提取
applyper_2 = LBApplyAnalysisPeriod(
    data=[importepw_2.dry_bulb_temperature, importepw_2.dew_point_temperature, importepw_2.relative_humidity, importepw_2.wind_speed, importepw_2.wind_direction, importepw_2.direct_normal_rad, importepw_2.diffuse_horizontal_rad, importepw_2.global_horizontal_rad, importepw_2.horizontal_infrared_rad, importepw_2.direct_normal_ill, importepw_2.diffuse_horizontal_ill, importepw_2.global_horizontal_ill, importepw_2.total_sky_cover, importepw_2.barometric_pressure, importepw_2.ground_temperature, importepw_2.model_year],
    period=analysisperiod.period)  # -> data; plug-in component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
xdata_2 = LBDeconstructData(data=applyper_2)  # -> header, values; plug-in component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

# ----
applyper_3 = LBApplyAnalysisPeriod(
    data=[importepw.diffuse_horizontal_rad, importepw.global_horizontal_rad, importepw.horizontal_infrared_rad],
    period=analysisperiod.period)  # -> data; plug-in component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
xdata_3 = LBDeconstructData(data=applyper_3)  # -> header, values; plug-in component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
graft_tree = GraftTree(Tree=xdata_3.values, IncludeEmptyLists=True, IncludeNullItems=True)  # -> flatten(Tree)
panel_4 = Panel(applyper_3)
panel_5 = Panel(graft_tree)
panel_6 = Panel(xdata_2.values)
list_length = ListLength(List=panel_5)
panel_7 = Panel(xdata_3.values)
division = Division(A=list_length, B=Slider(24, range=0..100))
graft_tree_2 = GraftTree(Tree=panel_7, IncludeEmptyLists=True, IncludeNullItems=True)
partition_list = PartitionList(List=panel_5, Size=division)
panel_8 = Panel(graft_tree_2)

已拍平数据 = Panel(graft_tree)
file_path_2 = FilePath()
excel_write = ExcelWrite(
    WriteExcelData=Toggle(False),
    WorkbookPath=file_path_2,
    WorksheetName="Sheet1",
    ColumnHeadings="Name",
    Data=已拍平数据,
    ClearSheet=Toggle(False))

# ----
# 之后如何处理呢？
三等分数据 = Panel(partition_list)
