# Grasshopper definition 城市建筑生成.gh (Grasshopper 1.0.7)
# plug-ins: Bifocals, LunchBox, Weaverbird

# ---- group: building
file_path = FilePath("D:\RHGH\OSM_data\青岛openstreet数据\planet_119.79_35.745_71fbb847-shp\shape\buildings.shx")
import_shp = ImportSHP(File=file_path)  # -> Points, Curves, Regions

# ---- group: land
file_path_2 = FilePath("D:\RHGH\OSM_data\青岛openstreet数据\planet_119.79_35.745_71fbb847-shp\shape\landuse.shx")
import_shp_2 = ImportSHP(File=file_path_2)  # -> Points, Curves, Regions

# ---- group: railway
file_path_3 = FilePath("D:\RHGH\OSM_data\青岛openstreet数据\planet_119.79_35.745_71fbb847-shp\shape\railways.shx")
import_shp_3 = ImportSHP(File=file_path_3)  # -> Points, Curves, Regions

# ---- group: raods
file_path_4 = FilePath("D:\RHGH\OSM_data\青岛openstreet数据\planet_119.79_35.745_71fbb847-shp\shape\roads.shx")
import_shp_4 = ImportSHP(File=file_path_4)  # -> Points, Curves, Regions

# ---- group: waterway
file_path_5 = FilePath("D:\RHGH\OSM_data\青岛openstreet数据\planet_119.79_35.745_71fbb847-shp\shape\waterways.shx")
import_shp_5 = ImportSHP(File=file_path_5)  # -> Points, Curves, Regions

# ----
file_path_6 = FilePath("J:\犀流堂\网站建设\网站课程\Grasshopper\城市建筑快速生成\二线城市\青岛建筑轮廓数据\青岛.shp")
import_shp_6 = ImportSHP(File=file_path_6)  # -> Points, Curves, Regions

file_path_7 = FilePath("J:\犀流堂\网站建设\网站课程\Grasshopper\城市建筑快速生成\二线城市\青岛建筑轮廓数据\青岛.xlsx")
excel_reader = ExcelReader(ReadExcelData=Toggle(True), WorkbookPath=file_path_7, WorksheetName="青岛")  # -> Exceptions, ExcelData
scale = Scale(Geometry=import_shp.Curves, Center=Point(0, 0, 0), Factor="100000")  # -> Geometry, Transform
scale_2 = Scale(Geometry=import_shp_2.Curves, Center=Point(0, 0, 0), Factor="100000")  # -> Geometry, Transform
scale_3 = Scale(Geometry=import_shp_3.Curves, Center=Point(0, 0, 0), Factor="100000")  # -> Geometry, Transform
scale_4 = Scale(Geometry=import_shp_4.Curves, Center=Point(0, 0, 0), Factor="100000")  # -> Geometry, Transform
scale_5 = Scale(Geometry=import_shp_5.Curves, Center=Point(0, 0, 0), Factor="100000")  # -> Geometry, Transform
scale_6 = Scale(Geometry=import_shp_6.Curves, Center=Point(0, 0, 0), Factor="100000")  # -> Geometry, Transform
number_slider = Slider(3000, range=0..10000)
explode_tree = ExplodeTree(Data=excel_reader.ExcelData)  # -> Branch0, Branch1
cull_index = CullIndex(List=explode_tree.Branch1, Indices="10", Wrap=True)
split_list = SplitList(List=scale_6.Geometry, Index=number_slider)  # -> ListA, ListB
curve = Curve(scale_6.Geometry)
split_list_2 = SplitList(List=cull_index, Index=number_slider)  # -> ListA, ListB
层高 = Panel("10")
custom_preview = CustomPreview(Geometry=scale_5.Geometry, Material=ColourSwatch(SwatchColor=RGB(107, 168, 199)))
custom_preview_2 = CustomPreview(Geometry=scale_4.Geometry, Material=ColourSwatch(SwatchColor=RGB(0, 0, 0)))
multiplication = Multiplication(A=cull_index, B=层高)  # -> graft(Result)
boundary_surfaces = BoundarySurfaces(Edges=graft(curve))
panel = Panel(split_list_2.ListA)
settings_speed = SettingsSpeed()
mesh_brep = MeshBrep(Brep=boundary_surfaces, Settings=settings_speed)  # -> simplify(Mesh)
weaverbird_s_mesh_thicken = WeaverbirdsMeshThicken(MeshCurves=mesh_brep, Distance=expr("-x", multiplication), OffsetType=0)  # -> flatten(OutputMeshCurves)
radians = Radians(Degrees=Slider(75, range=0..100))
mesh_join = MeshJoin(Meshes=weaverbird_s_mesh_thicken)
unweld_mesh = UnweldMesh(Mesh=mesh_join, Angle=radians)
